# Grasshopper definition 230216_Team2Design.ghx (Grasshopper 1.0.7)
# plug-ins: Pufferfish

# ---- group: General Parameters
bifurcation_thickness = Slider(100, range=0..1000)
total_height = Slider(1750, range=0..2000)
number_slider = Slider(151, range=0..10000)
number_slider_2 = Slider(1218, range=0..10000)
wall__starting_point = Point(Point(692.5615605, 4678.179786, 0))

# ----
lower_height = Slider(1750, range=0..2000)

# ----
# Centerline of the Wall
python = GhPythonScript(st_pt=wall__starting_point, depth=number_slider, width=number_slider_2)  # -> out, crv, mid_pt; inputs st_pt: Point3d
# ---------- python: Python ----------
import Rhino.Geometry as rg

mid_pt= st_pt.Clone()
T_mid= rg.Transform.Translation(rg.Vector3d.YAxis*(width/2))
T_mid2=rg.Transform.Translation(rg.Vector3d.XAxis*depth)
mid_pt.Transform(T_mid)
mid_pt.Transform(T_mid2)

end_pt=st_pt.Clone()
T_end= rg.Transform.Translation(rg.Vector3d.YAxis*width)
end_pt.Transform(T_end)

crv= rg.Curve.CreateInterpolatedCurve([st_pt,mid_pt,end_pt],3)

crv.Domain=rg.Interval(0,1)
# ---------- end python ----------
pt = Point(python.mid_pt)

# ---- group: CENTERLINE OF THE WALL
crv = Curve(python.crv)

# ----
# Load classes from src
button = Button()
add_paths_from_local_dir = GhPythonScript(reload=button)  # -> dire
# ---------- add_paths_from_local_dir: Python ----------
import os
import sys

#get current file path
path = ghenv.Component.OnPingDocument().FilePath
#get parent directory of the parent directory
parentdir = os.path.dirname(os.path.dirname(path))
#go to root folder
root = os.path.dirname(parentdir)
#get src folder which contains classes
dire = os.path.join(root,'src')

print dire
#add path to sys
sys.path.append(dire)

ghenv.Component.Message = "paths added"

from compas_rhino import unload_modules

if reload:
    unload_modules("design_team2")
    unload_modules("planning")
    
    ghenv.Component.Message = "paths updated"
# ---------- end add_paths_from_local_dir ----------
panel = Panel(add_paths_from_local_dir)

# ---- group: Wall Type
list = ValueList({"Single_Layer", "Birfucated": "Bifurcated"}, selected="Birfucated")

# ---- group: Openings_Origins
pt_2 = Point(Point(911.7778402, 5493.561968, 0))  # disabled

# ---- group: Spacing
number_slider_3 = Slider(42, range=0..100)
number_slider_4 = Slider(32, range=0..100)
number_slider_5 = Slider(70, range=0..1000)

# ----
# Storage
graph = GraphMapper(x0=0, x1=1, y0=0, y1=5, container_name="Gaussian", factor=0.1097403169, mean=0.4891445935, sdev=0.2359389067)
division = Division(A=number_slider_5, B=2)
number_slider_6 = Slider(2, range=1..3)
toggle = BooleanToggle(True)
toggle_2 = BooleanToggle(False)
toggle_3 = BooleanToggle(False)
toggle_4 = BooleanToggle(True)
toggle_5 = BooleanToggle(False)
addition = Addition(A=division, B=5)
graph_2 = GraphMapper(x0=0, x1=1, y0=0, y1=4, container_name="Gaussian", factor=0.1181463599, mean=0.5003812313, sdev=0.1824579835)

# ----
# Wall Type / Openings
openings_size = Slider(10, range=0..100)

# ---- group: Bifurcation DIstances
opening_size = Data(openings_size)
multiplication = Multiplication(A=opening_size, B=Slider(3.38, range=0..10))
range = Range(Domain=Domain(0, 1), Steps=multiplication)
graph_3 = GraphMapper(range, x0=0, x1=1, y0=0, y1=4, container_name="Gaussian", factor=0.1181463599, mean=0.5003812313, sdev=0.1824579835)
multiplication_2 = Multiplication(A=graph_3, B=bifurcation_thickness)

# ----
python_2 = GhPythonScript(
    crv=crv,
    h_spacing=number_slider_5,
    v_spacing=number_slider_4,
    wall_type=list,
    lock_spacing=number_slider_3,
    origin_height=Slider(876, range=0..10000),
    opening_origin=pt_2,
    scale_factor=openings_size,
    bifurcation_thickness=bifurcation_thickness,
    bifurcation_dist=multiplication_2)  # -> out, pointsOnCrv, openings, b_list; inputs crv: Curve, opening_origin: list of Point3d, scale_factor: list, bifurcation_dist: tree
# ---------- python_2: Python ----------
import Rhino.Geometry as rg 
from ghpythonlib.treehelpers import tree_to_list as tl
from design_team2 import match_list_lengths, divide_crv, create_Openings

minor=32
major=75
tol=1

pointsOnCrv= divide_crv(crv,h_spacing,minor,major,tol)

if len(opening_origin)==0:
    opening_origin=[rg.Point3d(crv.PointAt(0.5).X,crv.PointAt(0.5).Y,origin_height)]

opening_origin,scale_factor=match_list_lengths(opening_origin,scale_factor)
openings = create_Openings(crv,wall_type, opening_origin,h_spacing,v_spacing,lock_spacing,bifurcation_thickness, scale_factor,pointsOnCrv)


#Bifurcation
if wall_type== "Bifurcated":
    bifurcation_dist= tl(bifurcation_dist, lambda x:x[0])
    opening_origin,bifurcation_dist=match_list_lengths(opening_origin,bifurcation_dist)

    b_list= [lock_spacing]*len(pointsOnCrv)
    for i, op in enumerate(openings):
        b_index= op.b_index
        for j, b in enumerate(bifurcation_dist[i]):
            b_list[b_index-(len(bifurcation_dist[i])//2)+j]+= b
# ---------- end python_2 ----------

# ---- group: Total_Height / Number of Columns
lng = ListLength(List=python_2.pointsOnCrv)

# ---- group: Total_Height
subtraction = Subtraction(A=lng, B=1)
range_2 = Range(Domain=Domain(0, 1), Steps=subtraction)
graph_4 = GraphMapper(range_2, x0=0, x1=1, y0=0, y1=1, container_name="Gaussian", factor=0.6563698649, mean=0.5014153123, sdev=0.2670120001)
total_height_2 = Data(total_height)
lowest_height = Data(lower_height)
subtraction_2 = Subtraction(A=total_height_2, B=lowest_height)
multiplication_3 = Multiplication(A=graph_4, B=subtraction_2)

# ---- group: Total_Height / List_of Heights
addition_2 = Addition(A=lowest_height, B=multiplication_3)

# ----
python_3 = GhPythonScript(
    total_height=total_height,
    heights=addition_2,
    v_spacing=number_slider_4,
    pointsOnCrv=python_2.pointsOnCrv,
    wall_type=list,
    lock_spacing=number_slider_3,
    openings=python_2.openings,
    b_list=python_2.b_list,
    prototype_name="Curved_Wall",
    extra_text="LV")  # -> out, shooting_points, flat_shooting_points, global_design; inputs heights: list, pointsOnCrv: list of Point3d, openings: list, b_list: list
# ---------- python_3: Python ----------
import Rhino.Geometry as rg 
import Grasshopper as gh # https://pypi.org/project/Grasshopper-stubs/

from compas.geometry import Curve, Point
from ghpythonlib.treehelpers import list_to_tree as _tree
from ghpythonlib.treehelpers import tree_to_list as _tl

from design_team2 import GlobalDesign

layers_num=int(total_height/v_spacing)


prototype_identifier = prototype_name + "_" +  extra_text

global_design= GlobalDesign.design_from_curve_with_Openings(wall_type,pointsOnCrv,openings,layers_num, v_spacing,b_list,heights, prototype_identifier)


#generate uid
global_design.generate_uid_for_all_parts()
shooting_points = global_design.visualize()

flat_shooting_points=[]
for s_p in (shooting_points):
    for s in s_p:
        flat_shooting_points.extend(s)


#Convert to tree to visualize
#shooting_points = _tree(shooting_points, source = lambda x:x)#
# ---------- end python_3 ----------

# ---- group: Openings
# Frames
python_4 = GhPythonScript(openings=python_2.openings)  # -> out, frame_size, outline, vis_line, brep; inputs openings: list
# ---------- python_4: Python ----------
vis_line=[x.visline for x in openings]
frame_size= [x.FrameSize() for x in openings]
brep= [x.brep for x in openings]
outline = [x.outline for x in openings]
# ---------- end python_4 ----------
crv_2 = Curve(python_4.outline)
crv_3 = Curve(python_4.vis_line)
geo = Geometry(python_4.brep)
panel_2 = Panel(python_4.frame_size)

# ---- group: Parts
data = Data(flatten(python_3.flat_shooting_points))

# ----
lng_2 = ListLength(List=data)  # -> flatten(Length)
# Points
panel_3 = Panel(lng_2)

ellipse = Ellipse(Plane=data, Radius1=Slider(75, range=0..100), Radius2=Slider(32, range=0..100))  # -> Ellipse, Focus1, Focus2

# ---- group: Visualize Frame
frame_depth = Slider(200, range=0..500)  # disabled
slat_depth = Slider(25, range=0..100)  # disabled
slat_width = Slider(25, range=0..100)  # disabled
cluster = Cluster(crv=python_4.outline, x=slat_width, F=slat_depth, A_2=frame_depth, A=slat_depth)  # disabled
swatch = ColourSwatch(SwatchColor=RGB(207, 207, 207))  # disabled

# ---- group: Visualize Bullets
number_slider_7 = Slider(2, range=0..10)  # disabled
number_slider_8 = Slider(0.75, range=0..1)  # disabled
division_2 = Division(A=number_slider_5, B=2)  # disabled
sph = Sphere(Base=data, Radius=division_2)  # disabled
swatch_2 = ColourSwatch(SwatchColor=RGB(130, 130, 130))  # disabled
swatch_3 = ColourSwatch(SwatchColor=RGB(207, 207, 207))  # disabled
scale_nu = ScaleNU(Geometry=sph, Plane=data, ScaleX=number_slider_7, ScaleY=number_slider_8, ScaleZ=1)  # -> Geometry, Transform; disabled

# ---- group: Check the sequence
python_5 = GhPythonScript(points=data, index=Slider(441, range=0..750))  # -> out, p, a; inputs points: list of Point3d, index: Int32
# ---------- python_5: Python ----------
import Rhino.Geometry as rg

p=[]
for i in range(index):
    p.append(points[i])

a= rg.Sphere(points[index], 25)
# ---------- end python_5 ----------
listdexs = ListIndices(List=python_5.p)
pline = PolyLine(Vertices=python_5.p, Closed=False)
tag = TextTag(Location=python_5.p, Text=listdexs)
geo_2 = Geometry(python_5.a)

# ----
# Openings
preview = CustomPreview(Geometry=cluster, Material=swatch)  # disabled

# ----
# Bullets
preview_2 = CustomPreview(Geometry=scale_nu.Geometry, Material=swatch_2)  # disabled

# ==== cluster Cluster
crv = ClusterInput()
A = ClusterInput()
crv_2 = Curve(crv)
multiplication = Multiplication(A=A, B=2)
A_2 = ClusterInput()
explode = Explode(Curve=crv_2, Recursive=True)  # -> Segments, Vertices
F = ClusterInput()
division = Division(A=A_2, B=multiplication)
dispatch = Dispatch(List=explode.Segments, DispatchPattern=[True, False])  # -> ListA, ListB
X = UnitX(Factor=F)
round = Round(Number=division)  # -> Nearest, Floor, Ceiling
extr = Extrude(Base=dispatch.ListA, Direction=X)
neg = Negative(Value=X)
extr_2 = Extrude(Base=dispatch.ListB, Direction=neg)
x = ClusterInput()
flip = Flip(Surface=extr_2)  # -> Surface, Result
neg_2 = Negative(Value=x)
multiplication_2 = Multiplication(A=X, B=2)
multiplication_3 = Multiplication(A=X, B=3)
offsrf = OffsetSurface(Surface=[flip.Surface, extr], Distance=neg_2, BothSides=0, CreateSolid=True)
neg_3 = Negative(Value=multiplication_3)
arrlinear = LinearArray(Geometry=offsrf, Direction=multiplication_2, Count=round.Nearest)  # -> Geometry, Transform
move = Move(Geometry=arrlinear.Geometry, Motion=neg_3)  # -> Geometry, Transform
G = ClusterOutput(move.Geometry)
